# Dynamo graph WIP_Dyn_16_SpatialPlanning From Excel.dyn "Dyn_13_SpatialPlanning From Excel" (Dynamo 2.6.2.15705)

# note: Important stuff
# Purple will indicate something important is going on here.
# note: Checking / Outputs
# Orange indicates checking nodes to ensure the script has deployed correctly.
# note: Working / Functions
# Green indicates the working of the script. No changes should be made in these groups unless advised.
# note: Variables / Inputs
# Red indicates Variables that can be altered per project and must be set accordingly before running the script.

# group: Revit file!
# note: Use this file in combination with the following Revit file:
# Dyn_08_09_12_13_14_15_Exercises.rvt

# group: Excel file!
# note: The following worksheet contains all needed Sheet data :
# Dyn_13_Create Sheets from Excel file.xlsx

# group: Dyn_13_Spatial Plan from Excel
# note: Exercise & Hints
# Create Sheets and fill in Sheet required parameters from an excel worksheet.
# Excel data must be cleaned
# 	 null values, non-desired columns,...
# Not all deliverables in the Excel file are neccesarely Revit Drawings:
# 	If you check Type column only [D] values correspond to Drawings.
#  Try to set  all Sheet Parameters like the did in the previous file
# Challenge: Set Sheet Browser mapping values!
# note: Workflow
# 1. Get Excel Data
# 2. Drop unnecesary Data
# 3. Transpose data so that each columns correspond to a parameter
# 4. Replace null values with empty string
# 5. Filter Type “D”  values (Drawings)
# 6. Get each sublist separately
# 7. Compare Sheet Size With Titleblock Family
# 8. Create Sheets!
# 9. Set Sheet Parameters by using all grabbed data on step 6
# 10. Extra Browser parameter values?

# group: File path
# note: 1. Reading excel file
file_path = Filename(".\LabsRoomData.xlsx")

code_block = CodeBlock { "Sheet1"; true; false; }

# group: Import Excel file
file_from_path = FileObject(path=file_path)
importExcel = Data.ImportExcel(file=file_from_path, sheetName=code_block.out0, showExcel=code_block.out2)

string_from_object = FromObject(object=importExcel)

# group: Work Excel Data
code_block_2 = CodeBlock(input=string_from_object)  # unwired: sorted_data
# ---------- code_block_2.designscript (19 lines) ----------
//Get Raw excel data
raw_excel = input;
headers = input[0];
drop_headers = List.DropItems(raw_excel,1);
transpose = List.Transpose(drop_headers);
clean_data = String.Replace(transpose, "null" ,"");

//Get each data column
room_number = sorted_data[0];
room_name = sorted_data[1];
param01 = sorted_data[2];

zoning = sorted_data[4];
required_area = String.ToNumber(clean_data[5]);
count = sorted_data[6];


side = Math.Round(Math.Sqrt(required_area * 1000000));
List.MaximumItem(side);
# ----------------------------------------

# group: Group Keys based on Value
code_block_3 = CodeBlock(input=code_block_2.clean_data)
# ---------- code_block_3.designscript (7 lines) ----------
data = input;
grouping_keys = input[4];

// Group keys by value (Zoning in this example)
grouped = List.GroupByKey(data<2>,grouping_keys);
groups = Dictionary.ValueAtKey(grouped, "groups" );
List.Transpose(groups);
# ----------------------------------------

# group: Create Placement Point Matrix
code_block_4 = CodeBlock { 0; }
getItemAtIndex = List.GetItemAtIndex(list=code_block_3.out4@L3, index=code_block_4)
count = List.Count(list=getItemAtIndex@L2)
code_block_5 = CodeBlock(number=count, step=code_block_2.out12) { List.Flatten(0..#number..step); }
count_2 = List.Count(list=getItemAtIndex)
code_block_6 = CodeBlock(number=count_2, step=code_block_2.out12) { List.Flatten(0..#number..-step); }
cycle = List.Cycle(list=code_block_6@L1, amount=count@L1)
flatten = List.Flatten(list=cycle)
code_block_7 = CodeBlock(x=code_block_5, y=flatten) { Point.ByCoordinates(x,y,0); }

# group: Place Family Instances at Points
code_block_8 = CodeBlock { FamilyType.ByName("00_GM_Box"); }
code_block_9 = CodeBlock(fam=code_block_8, point=code_block_7) { FamilyInstance.ByPoint(fam,point); }
family_types = FamilyTypes()  # nothing selected

# group: Instances
instances = Watch(code_block_9)

# group: Set Data
code_block_10 = CodeBlock(input=instances, input_area=code_block_2.required_area, input_height=code_block_2.side)
# ---------- code_block_10.designscript (5 lines) ----------
families = input;

//Set Parameters
Elements.Element.SetParameterByName(families, "K_Area", input_area);
Elements.Element.SetParameterByName(families, "Length", input_height);
# ----------------------------------------

# group: Check Point Matrix
watch = Watch(code_block_7)
